# Dynamo custom node CheckAreas&CreateList.dyf (Dynamo 2.0.3.8810)
# category: TFNodes.ModelAudit
# Check if there are unplaced/not enclosed areas and create list

code_block = CodeBlock { " "; }
code_block_2 = CodeBlock { "Areas"; }
byName = Category.ByName(name=code_block_2)
all_elements_of_category = ElementsOfCategory(Category=byName)
area = Python(IN[0]=all_elements_of_category)
# ---------- area.python (26 lines) ----------
import clr
clr.AddReference('ProtoGeometry')
from Autodesk.DesignScript.Geometry import *
clr.AddReference('RevitAPI')
from Autodesk.Revit.DB import *
# Import Element wrapper extension methods
clr.AddReference("RevitNodes")
import Revit
clr.ImportExtensions(Revit.Elements)
# Import DocumentManager and TransactionManager
clr.AddReference("RevitServices")
import RevitServices
from RevitServices.Persistence import DocumentManager
from RevitServices.Transactions import TransactionManager
doc = DocumentManager.Instance.CurrentDBDocument

#The inputs to this node will be stored as a list in the IN variables.
elementList = IN[0]
locationList = []

for element in elementList:
	param = UnwrapElement(element).Area
	locationList.append(param)	
	
#Assign your output to the OUT variable.
OUT = locationList
# ----------------------------------------
code_block_3 = CodeBlock(func=area) { func != 0; }
countFalse = List.CountFalse(list=code_block_3)
string_from_object = FromObject(obj=countFalse)
test = CodeBlock(func=countFalse) { func == 0; }
code_block_4 = CodeBlock { "APPROVED"; "FAILED"; }
if_ = If(test=test, true=code_block_4.out0, false=code_block_4.out1)
join = String.Join(separator=code_block, string0=string_from_object, string1=if_)
overallStatus = Output(join)
id = Element.Id(element=all_elements_of_category)
name = Element.Name(element=all_elements_of_category)
if_2 = If(test=code_block_3, true=code_block_4.out0, false=code_block_4.out1)
create = List.Create(item0=id, item1=name, item2=if_2)
transpose = List.Transpose(lists=create)
lists = Output(transpose)
