# Dynamo custom node CheckDesignOption.dyf (Dynamo 1.3.4.6666)
# category: TFNodes.ModelAudit
# Check if there are design options in the project

toggle = Input(toggle : bool)
designOptions = Custom[Document.DesignOptions]()  # Returns all design options in the model, grouped by design option set
isNull = Object.IsNull(designOptions.DesignOptionSets)
countFalse = CountFalse(isNull)
code_block = CodeBlock { 0; }
eq = countFalse == code_block
code_block_2 = CodeBlock { "APPROVED"; "FAILED"; }
if_ = If(test=eq, true=code_block_2.out0, false=code_block_2.out1)
result = Output(if_)
