# Dynamo custom node CheckFileSize.dyf (Dynamo 1.3.4.6666)
# category: TFNodes.ModelAudit
# Check if the file size is less than 300Mb.

filePath = Input()
code_block = CodeBlock { kbOnly:bool = true; }
fileSize = Python(IN[0]=filePath, IN[1]=code_block)
# ---------- fileSize.python (25 lines) ----------
# Copyright(c) 2017, Dimitar Venkov
# @5devene, dimitar.ven@gmail.com
# www.badmonkeys.net

from System.IO import FileInfo

def tolist(x):
	if hasattr(x,'__iter__'): return x
	else : return [x]

def output(x):
	if len(x) == 1: return x[0]
	else : return x

paths = tolist(IN[0])
mb = 1048576.0
kb = 1024.0
def getSize(p, mb=mb, kb=kb, kbOnly = IN[1]):
	sb = FileInfo(p).Length
	if sb < mb or kbOnly:
		return '%.3f KB' % (sb / kb)
	else:
		return '%.3f MB' % (sb / mb)

OUT = output(map(getSize, paths) )
# ----------------------------------------
code_block_2 = CodeBlock { 300000; }
gt = fileSize > code_block_2
code_block_3 = CodeBlock { "FAILED"; "APPROVED"; }
if_ = If(test=gt, true=code_block_3.out0, false=code_block_3.out1)
flatten = Flatten(if_)
StatusResult = Output(flatten)
FileSize = Output(fileSize)
