# Dynamo custom node CheckInPlaceFamilies.dyf (Dynamo 2.0.3.8810)
# category: TFNodes.ModelAudit
# Check if there are any in-place families in the project and return the list of the in-place families found

code_block = CodeBlock { "Family"; }
element_type_by_name = Custom[Element Type By Name](TypeName=code_block)  # Select a Revit Element Type given its name.
all_elements_of_type = ElementsOfType(element_type=element_type_by_name)
python_script = Python(IN[0]=all_elements_of_type)
# ---------- python_script.python (14 lines) ----------
import clr
import System
clr.AddReference('RevitAPI')
from Autodesk.Revit.DB import *

fams = UnwrapElement(IN[0])
elementlist = list()

for fam in fams:
	try:
		elementlist.append(fam.IsInPlace)
	except:
		elementlist.append(False)
OUT = elementlist
# ----------------------------------------
countTrue = List.CountTrue(list=python_script)
code_block_2 = CodeBlock(count=countTrue) { count != 0? "FAILED" : "APPROVED"; }
OverallResult = Output(code_block_2)
string_from_object = FromObject(obj=python_script)
returnInPlaceELements = Python(IN[0]=string_from_object, IN[1]=all_elements_of_type)
# ---------- returnInPlaceELements.python (14 lines) ----------
import clr
import System
clr.AddReference('RevitAPI')
from Autodesk.Revit.DB import *

boolList = IN[0]
elementList = IN[1]
resultList = []

for bool, element in zip(boolList, elementList):
	if bool == "true":
		resultList.append(element)

OUT = resultList
# ----------------------------------------
id = Element.Id(element=returnInPlaceELements)
name = Element.Name(element=returnInPlaceELements)
create = List.Create(item0=id, item1=name)
transpose = List.Transpose(lists=create)
InPlaceFamiliesList = Output(transpose)
