# Dynamo custom node CheckLinks_Imports.dyf (Dynamo 1.3.4.6666)
# category: TFNodes.ModelAudit
# Check if there are Links and Import in the file

python_script = Python()
# ---------- python_script.python (21 lines) ----------
import clr
clr.AddReference('RevitAPI')
from Autodesk.Revit.DB import *
import Autodesk

clr.AddReference("RevitServices")
import RevitServices
from RevitServices.Persistence import DocumentManager

doc = DocumentManager.Instance.CurrentDBDocument
# need to learn how to implement LINQ here...
collector = FilteredElementCollector(doc)
impinst = collector.OfClass(ImportInstance).ToElements()
linkedlist = list()
importlist = list()
for item in impinst:
	if item.IsLinked:
		linkedlist.append(item)
	else:
		importlist.append(item)
OUT = (linkedlist,importlist)
# ----------------------------------------
code_block = CodeBlock(seq=python_script) { seq[0]; seq[1]; }
count = Count(code_block.out0)
test = CodeBlock(func=count) { func == 0; }
code_block_2 = CodeBlock { "APPROVED"; "FAILED"; }
if_ = If(test=test, true=code_block_2.out0, false=code_block_2.out1)
linkResult = Output(if_)
count_2 = Count(code_block.out1)
importCount = Output(count_2)
importList = Output(code_block.out1)
test_2 = CodeBlock(func=count_2) { func == 0; }
code_block_3 = CodeBlock { "APPROVED"; "FAILED"; }
if_2 = If(test=test_2, true=code_block_3.out0, false=code_block_3.out1)
importResult = Output(if_2)
linkCount = Output(count)
