# Dynamo custom node CheckRevitLink&CreateList.dyf (Dynamo 2.0.3.8810)
# category: TFNodes.ModelAudit
# Check if the Revit link version matches with the main Revit file and return list with results

empty = List.Empty()
python_script = Python(IN[0]=empty)
# ---------- python_script.python (50 lines) ----------
#Copyright(c) 2015, Konrad K Sobon
# @arch_laboratory, http://archi-lab.net

# Huge thanks to Andreas Dieckmann for 
# adding link path functionality

import clr
clr.AddReference('ProtoGeometry')
from Autodesk.DesignScript.Geometry import *

# Import DocumentManager and TransactionManager
clr.AddReference("RevitServices")
import RevitServices
from RevitServices.Persistence import DocumentManager
from RevitServices.Transactions import TransactionManager

from System.Collections.Generic import *

# Import RevitAPI
clr.AddReference("RevitAPI")
import Autodesk
from Autodesk.Revit.DB import *
from Autodesk.Revit.DB.Analysis import *

doc = DocumentManager.Instance.CurrentDBDocument
uiapp = DocumentManager.Instance.CurrentUIApplication
app = uiapp.Application

# Import ToDSType(bool) extension method
clr.AddReference("RevitNodes")
import Revit
clr.ImportExtensions(Revit.Elements)

#The inputs to this node will be stored as a list in the IN variable.
dataEnteringNode = IN

collector = Autodesk.Revit.DB.FilteredElementCollector(doc)
linkInstances = collector.OfClass(Autodesk.Revit.DB.RevitLinkInstance)

linkDoc, linkName, linkPath = [], [], []
for i in linkInstances:
	linkDoc.append(i.GetLinkDocument())
	linkName.append(i.Name)
	try:
		linkPath.append(i.GetLinkDocument().PathName)
	except:
		linkPath.append(None)
		pass

OUT = linkDoc, linkName, linkInstances, linkPath
# ----------------------------------------
code_block = CodeBlock { "Not found"; }
replaceNull = Custom[List.ReplaceNull](seq=python_script, replacement=code_block)  # Replaces all null values within a given list with a substitute
number = DoubleInput(1)  # graph input
linkName = List.GetItemAtIndex(list=replaceNull, index=number)
count = List.Count(list=linkName)
test = CodeBlock(func=count) { func == 0; }
code_block_2 = CodeBlock { "APPROVED"; "FAILED"; }
if_ = If(test=test, true=code_block_2.out0, false=code_block_2.out1)
OverallStatus = Output(if_)
mainRevitFile = Input(mainRevitFile: var[]..[])
number_2 = DoubleInput(3)  # graph input
linkPath = List.GetItemAtIndex(list=replaceNull, index=number_2)
code_block_3 = CodeBlock(item=linkPath) { DSCore.List.Flatten([item]); }
python_script_2 = Python(IN[0]=code_block_3)
# ---------- python_script_2.python (39 lines) ----------
#Copyright(c) 2017, john pierson
# @60secondrevit, http://sixtysecondrevit.com
import clr
clr.AddReference('ProtoGeometry')
from Autodesk.DesignScript.Geometry import *

# Import Element wrapper extension methods
clr.AddReference("RevitNodes")
import Revit
clr.ImportExtensions(Revit.Elements)

# Import geometry conversion extension methods
clr.ImportExtensions(Revit.GeometryConversion)

# Import DocumentManager and TransactionManager
clr.AddReference("RevitServices")
import RevitServices
from RevitServices.Persistence import DocumentManager
from RevitServices.Transactions import TransactionManager

doc = DocumentManager.Instance.CurrentDBDocument
uiapp = DocumentManager.Instance.CurrentUIApplication
app = uiapp.Application

# Import RevitAPI
clr.AddReference("RevitAPI")
import Autodesk
from Autodesk.Revit.DB import *

items = IN[0]

typelist = list()
for i in items:
	try:
		typelist.append(BasicFileInfo.Extract(i).SavedInVersion)
	except:
		typelist.append("Not found")
		
OUT = typelist
# ----------------------------------------
count_2 = List.Count(list=python_script_2)
code_block_4 = CodeBlock(input=count_2) { input>1; }
firstItem = List.FirstItem(list=python_script_2)
if_2 = If(test=code_block_4, true=python_script_2, false=firstItem)
replaceEmptyLists = Custom[List.ReplaceEmptyLists](seq=if_2, Replacement=code_block)  # Replaces all empty lists within a given list with a substitute
eq = mainRevitFile == replaceEmptyLists
code_block_5 = CodeBlock { "APPROVED"; "FAILED"; }
if_3 = If(test=eq, true=code_block_5.out0, false=code_block_5.out1)
create = List.Create(item0=linkName, item1=if_3)
transpose = List.Transpose(lists=create)
resultList = Output(transpose)
