# Dynamo custom node CheckRevitVersionMainFile.dyf (Dynamo 1.3.4.6666)
# category: TFNodes.ModelAudit
# Check if the revit version of the main file is matching with the year specified in the starting page and return flatten list

familyType = Input()
code_block = CodeBlock { "Info_Software_Year"; }
getParameterValueByName = Element.GetParameterValueByName(element=familyType, parameterName=code_block)
RevitFileYear = Input()
eq = getParameterValueByName == RevitFileYear
code_block_2 = CodeBlock { "APPROVED"; "FAILED"; }
if_ = If(test=eq, true=code_block_2.out0, false=code_block_2.out1)
flatten = Flatten(if_)
resultList = Output(flatten)
StartPageYear = Output(getParameterValueByName)
