# Dynamo custom node CheckRevitWarnings&CreateList.dyf (Dynamo 1.3.4.6666)
# category: TFNodes.ModelAudit
# Check the Revit Warning and return summary report and detailed report

RevitErrorReport = Input()
warningsReport = Custom[WarningsReport](report=RevitErrorReport)  # Get warnings report and organize it by error msgs, affected element, unique error and number of error
OverallStatus = Output(warningsReport.Status)
create = List.Create(warningsReport.UniqueErrors, warningsReport.NumberOfError)
transpose = List.Transpose(create)
SummaryReport = Output(transpose)
create_2 = List.Create(warningsReport.errorMessage, warningsReport.AffectedElements)
transpose_2 = List.Transpose(create_2)
flatten = Flatten(transpose_2)
DetailedReport = Output(flatten)
