# Dynamo custom node CheckRooms&CreateList.dyf (Dynamo 2.0.3.8810)
# category: TFNodes.ModelAudit
# Check if there are unplaced/not enclosed rooms and return list with results

code_block = CodeBlock { " "; }
code_block_2 = CodeBlock { "Rooms"; }
byName = Category.ByName(name=code_block_2)
all_elements_of_category = ElementsOfCategory(Category=byName)
area = Room.Area(room=all_elements_of_category)
test = CodeBlock(func=area) { func != 0; }
countFalse = List.CountFalse(list=test)
string_from_object = FromObject(obj=countFalse)
test_2 = CodeBlock(func=countFalse) { func == 0; }
code_block_3 = CodeBlock { "APPROVED"; "FAILED"; }
if_ = If(test=test_2, true=code_block_3.out0, false=code_block_3.out1)
join = String.Join(separator=code_block, string0=string_from_object, string1=if_)
overallStatus = Output(join)
id = Element.Id(element=all_elements_of_category)
name = Element.Name(element=all_elements_of_category)
if_2 = If(test=test, true=code_block_3.out0, false=code_block_3.out1)
create = List.Create(item0=id, item1=name, item2=if_2)
transpose = List.Transpose(lists=create)
resultList = Output(transpose)
