# Dynamo custom node CheckStringByRegEx.dyf (Dynamo 1.3.4.6666)
# category: TFNodes.ModelAudit
# Validates a list of strings against a regular expression and returns true if successful, otherwise returns false.

RegularExpression = Input()
StringsToCheck = Input(StringsToCheck:string[])
python_script = Python(IN[0]=RegularExpression, IN[1]=StringsToCheck)
# ---------- python_script.python (15 lines) ----------
import clr
import re

regexstring = IN[0]
inputList = IN[1]

l = []

for i in inputList:
	if re.match(regexstring, i, 0):
		l.Add(True)
	else:
		l.Add(False)

OUT = l
# ----------------------------------------
Results = Output(python_script)
