# Dynamo custom node CheckUnnamedRefPlanes&CreateList.dyf (Dynamo 2.0.3.8810)
# category: TFNodes.ModelAudit
# Check if there are unnamed reference planes and return list with the results

code_block = CodeBlock { "Reference Planes"; }
byName = Category.ByName(name=code_block)
all_elements_of_category = ElementsOfCategory(Category=byName)
if_ = Python(IN[0]=all_elements_of_category)
# ---------- if_.python (24 lines) ----------
import clr
clr.AddReference('ProtoGeometry')
from Autodesk.DesignScript.Geometry import *
clr.AddReference('RevitAPI')
from Autodesk.Revit.DB import *
# Import Element wrapper extension methods
clr.AddReference("RevitNodes")
import Revit
clr.ImportExtensions(Revit.Elements)

#The inputs to this node will be stored as a list in the IN variables.
refPlaneList = IN[0]
refNameList = []

for refPlane in refPlaneList:
	name = refPlane.Name
	if name == "Reference Plane": 
		name = "FAILED"
	else: 
		name = "APPROVED"	
	refNameList.append(name)
			
#Assign your output to the OUT variable.
OUT = refNameList
# ----------------------------------------
code_block_2 = CodeBlock { "FAILED"; "APPROVED"; }
containsKey = ContainsKey(list=if_, key=code_block_2.out0)
countTrue = List.CountTrue(list=containsKey)
test = CodeBlock(func=countTrue) { func != 0; }
if_2 = If(test=test, true=code_block_2.out1, false=code_block_2.out0)
overallStatus = Output(if_2)
elements = Output(all_elements_of_category)
categories = Output(byName)
id = Element.Id(element=all_elements_of_category)
name = Element.Name(element=all_elements_of_category)
strings = CodeBlock { "Reference Plane"; "None"; }
replace = String.Replace(str=name, searchFor=strings.out0, replaceWith=strings.out1)
create = List.Create(item0=id, item1=replace, item2=if_)
transpose = List.Transpose(lists=create)
resultList = Output(transpose)
