# Dynamo custom node CheckViewsOnSheet&CreateList.dyf (Dynamo 2.3.0.5885)
# category: TF-Nodes.ModelAudit
# Check if the views are on sheets and return result list
# packages: Clockwork for Dynamo 1.x 1.31.1, archi-lab.net 2020.23.7

code_block = CodeBlock { "Views"; }
byName = Category.ByName(name=code_block)
all_elements_of_category = ElementsOfCategory(Category=byName)
clear_list = Custom[Clear List](input=all_elements_of_category)  # package archi-lab.net; This node will remove all Null and Empty Lists from any list.
get_list_of_schedules_on_sheet = Python(IN[0]=clear_list)
# ---------- get_list_of_schedules_on_sheet.python (29 lines) ----------
import clr
clr.AddReference('ProtoGeometry')
from Autodesk.DesignScript.Geometry import *

# Import ToDSType(bool) extension method
clr.AddReference("RevitNodes")
import Revit
clr.ImportExtensions(Revit.Elements)

# Import DocumentManager and TransactionManager
clr.AddReference("RevitServices")
import RevitServices
from RevitServices.Persistence import DocumentManager
from RevitServices.Transactions import TransactionManager

from System.Collections.Generic import *

# Import RevitAPI
clr.AddReference("RevitAPI")
import Autodesk
from Autodesk.Revit.DB import *
doc = DocumentManager.Instance.CurrentDBDocument
Views = UnwrapElement(IN[0])
tempViews = []
#looks at individual sheets
for view in Views:
	tempViews.append(view.IsTemplate)
		
OUT = tempViews
# ----------------------------------------
filterByBoolMask = List.FilterByBoolMask(list=clear_list, mask=get_list_of_schedules_on_sheet)
code_block_2 = CodeBlock { "TF-Category"; }
getParameterValueByName = Element.GetParameterValueByName(element=filterByBoolMask.out, parameterName=code_block_2)
code_block_3 = CodeBlock { ""; }
eq = getParameterValueByName == code_block_3
code_block_4 = CodeBlock { "VIEW CATEGORY"; }
getParameterValueByName_2 = Element.GetParameterValueByName(element=filterByBoolMask.out, parameterName=code_block_4)
code_block_5 = CodeBlock { ""; }
eq_2 = getParameterValueByName_2 == code_block_5
code_block_6 = CodeBlock { "View Category"; }
getParameterValueByName_3 = Element.GetParameterValueByName(element=filterByBoolMask.out, parameterName=code_block_6)
if_ = If(test=eq_2, true=getParameterValueByName_3, false=getParameterValueByName_2)
if_2 = If(test=eq, true=if_, false=getParameterValueByName)
ViewNamesToSkip = Input(ViewNamesToSkip: var[]..[])
contains = String.Contains(str=if_2, searchFor=ViewNamesToSkip)
filterByBoolMask_2 = List.FilterByBoolMask(list=filterByBoolMask.out, mask=contains)
filterByBoolMask_3 = List.FilterByBoolMask(list=if_2, mask=contains)
code_block_7 = CodeBlock { "STARTING PAGE"; }
contains_2 = String.Contains(str=filterByBoolMask_3.out, searchFor=code_block_7)
filterByBoolMask_4 = List.FilterByBoolMask(list=filterByBoolMask_2.out, mask=contains_2)
code_block_8 = CodeBlock { "Sheet Name"; }
getParameterValueByName_4 = Element.GetParameterValueByName(element=filterByBoolMask_4.out, parameterName=code_block_8)
code_block_9 = CodeBlock(func=getParameterValueByName_4) { func == ""; }
anyTrue = Custom[List.AnyTrue](seq=code_block_9)  # package Clockwork for Dynamo 1.x; Returns true if any item in a list of booleans is true.
code_block_10 = CodeBlock { "FAILED"; "APPROVED"; }
if_3 = If(test=anyTrue, true=code_block_10.out0, false=code_block_10.out1)
OverallStatus = Output(if_3)
id = Element.Id(element=filterByBoolMask_4.out)
name = Element.Name(element=filterByBoolMask_4.out)
code_block_11 = CodeBlock { "Sheet Number"; }
getParameterValueByName_5 = Element.GetParameterValueByName(element=filterByBoolMask_4.out, parameterName=code_block_11)
filterByBoolMask_5 = List.FilterByBoolMask(list=filterByBoolMask_3.out, mask=contains_2)
code_block_12 = CodeBlock { "FAILED"; "APPROVED"; }
if_4 = If(test=code_block_9, true=code_block_12.out0, false=code_block_12.out1)
create = List.Create(item0=id, item1=name, item2=getParameterValueByName_4, item3=getParameterValueByName_5, item4=filterByBoolMask_5.out, item5=if_4)
transpose = List.Transpose(lists=create)
Results = Output(transpose)
code_block_13 = CodeBlock { "(TEMP)"; }
