# Dynamo custom node Element Type By Name.dyf (Dynamo 2.0.3.8810)
# category: TFNodes
# Select a Revit Element Type given its name.

TypeName = Input(TypeName: string)
python_script = Python(IN[0]=TypeName)
# ---------- python_script.python (47 lines) ----------
# Enable Python support and load DesignScript library
import clr
clr.AddReference("RevitServices")
import RevitServices
from RevitServices.Persistence import DocumentManager
clr.AddReference("System")
from System import *
from System.Reflection import *

element_type_name = IN[0]

# Checking Revit Year and adjusting the DLL import
revit_year = RevitServices.Persistence.DocumentManager.Instance.CurrentUIApplication.Application.VersionNumber

# Getting all types from Assembly RevitAPI 2016
if revit_year == "2016":
    assembly = Assembly.LoadFile("C:\\Program Files\\Autodesk\\Revit 2016\\RevitAPI.dll")
    types = assembly.GetTypes()

    for element in types:
        if element.ToString().EndsWith("." + element_type_name) and element.ToString().StartsWith("Autodesk.Revit.DB"):
            OUT = element

# Getting all types from Assembly RevitAPI 2018
if revit_year == "2018":
    assembly = Assembly.LoadFile("C:\\Program Files\\Autodesk\\Revit 2018\\RevitAPI.dll")
    types = assembly.GetTypes()

    for element in types:
        if element.ToString().EndsWith("." + element_type_name) and element.ToString().StartsWith("Autodesk.Revit.DB"):
            OUT = element
# Getting all types from Assembly RevitAPI 2019
if revit_year == "2019":
    assembly = Assembly.LoadFile("C:\\Program Files\\Autodesk\\Revit 2019\\RevitAPI.dll")
    types = assembly.GetTypes()

    for element in types:
        if element.ToString().EndsWith("." + element_type_name) and element.ToString().StartsWith("Autodesk.Revit.DB"):
            OUT = element
# Getting all types from Assembly RevitAPI 2020
if revit_year == "2020":
    assembly = Assembly.LoadFile("C:\\Program Files\\Autodesk\\Revit 2020\\RevitAPI.dll")
    types = assembly.GetTypes()

    for element in types:
        if element.ToString().EndsWith("." + element_type_name) and element.ToString().StartsWith("Autodesk.Revit.DB"):
            OUT = element
# ----------------------------------------
Element_Type = Output(python_script)  # "Element Type: var"
