# Dynamo custom node ElementStartPage.dyf "Element Start Page" (Dynamo 2.0.3.8810)
# category: TFNodes.ModelAudit
# Element Start Page

element_types = ElementTypes(index=120)  # graph input
all_elements_of_type = ElementsOfType(element_type=element_types)
type = archilab.Revit.Elements.Elements.Type(element=all_elements_of_type)
family = FamilyType.Family(familyType=type)
code_block = CodeBlock(a=family) { a.Name; }
code_block_2 = CodeBlock { "Project"; }
contains = String.Contains(str=code_block, searchFor=code_block_2)
filterByBoolMask = List.FilterByBoolMask(list=all_elements_of_type, mask=contains)
type_2 = archilab.Revit.Elements.Elements.Type(element=filterByBoolMask.in)
family_2 = FamilyType.Family(familyType=type_2)
code_block_3 = CodeBlock(a=family_2) { a.Name; }
code_block_4 = CodeBlock { "Start"; }
contains_2 = String.Contains(str=code_block_3, searchFor=code_block_4)
filterByBoolMask_2 = List.FilterByBoolMask(list=filterByBoolMask.in, mask=contains_2)
type_3 = archilab.Revit.Elements.Elements.Type(element=filterByBoolMask_2.in)
family_3 = FamilyType.Family(familyType=type_3)
code_block_5 = CodeBlock(a=family_3) { a.Name; }
code_block_6 = CodeBlock { "Comment"; }
contains_3 = String.Contains(str=code_block_5, searchFor=code_block_6)
filterByBoolMask_3 = List.FilterByBoolMask(list=filterByBoolMask_2.in, mask=contains_3)
StartPageElement = Output(filterByBoolMask_3.out)
