# Dynamo custom node GenerateRevitWarningReportThroughAPI.dyf (Dynamo 2.0.3.8810)
# category: TFNodes.ModelAudit
# Generates Revit Warning Report by automarically getting the failing messages through API (It only work for Revit 2018 and above)

python_script = Python()
# ---------- python_script.python (34 lines) ----------
import clr
clr.AddReference('RevitAPI')
clr.AddReference('ProtoGeometry')
clr.AddReference('RevitNodes')
clr.AddReference("RevitServices")

import Autodesk.Revit.DB
import Autodesk.DesignScript.Geometry
import RevitServices
from RevitServices.Persistence import DocumentManager
import Autodesk
import Revit
import Revit.Elements

#Reference the API (Revit) document
doc1 = DocumentManager.Instance.CurrentDBDocument

warnings = doc1.GetWarnings()

#Define the lists for output
descriptions = []
severities = []
elementLists = []

#Add all the warnings data into 3 lists
for warning in warnings:
	descriptions.append(warning.GetDescriptionText())
	severities.append(warning.GetSeverity())
	elementIds = []
	for elementId in warning.GetFailingElements():
		elementIds.append(Revit.Elements.ElementWrapper.ToDSType(doc1.GetElement(elementId), 1))
	elementLists.append(elementIds)
	
OUT= (descriptions, elementLists)
# ----------------------------------------
code_block = CodeBlock(w=python_script) { w[0]; w[1]; }
id = Element.Id(element=code_block.out1)
create = List.Create(item0=code_block.out0, item1=id)
transpose = List.Transpose(lists=create)
flatten = List.Flatten(list=transpose)
FullReport = Output(flatten)
count = List.Count(list=code_block.out0)
test = CodeBlock(func=count) { func < 50; }
code_block_2 = CodeBlock { "APPROVED"; "FAILED"; }
if_ = If(test=test, true=code_block_2.out0, false=code_block_2.out1)
firstItem = List.FirstItem(list=if_)
OverallResult = Output(firstItem)
flatten_2 = List.Flatten(list=code_block.out0)
uniqueItems = List.UniqueItems(list=flatten_2)
summary_python = Python(IN[0]=uniqueItems, IN[1]=flatten_2)
# ---------- summary_python.python (18 lines) ----------
import clr
import System
clr.AddReference('RevitAPI')
from Autodesk.Revit.DB import *

listUniqueWarnings = IN[0]
listUniqueCounts = []
listWarnings = IN[1]
uniqueWarningIndex = 0
indexCount= 0
for uniqueWarning in listUniqueWarnings:
    listUniqueCounts.append(0)
    indexCount= uniqueWarningIndex
    uniqueWarningIndex = uniqueWarningIndex + 1
    for warning in listWarnings:
		if warning == uniqueWarning:
		    listUniqueCounts[indexCount] = listUniqueCounts[indexCount]+1
OUT= listUniqueWarnings,listUniqueCounts
# ----------------------------------------
code_block_3 = CodeBlock(a=summary_python) { a[0]; a[1]; }
create_2 = List.Create(item0=code_block_3.out0, item1=code_block_3.out1)
summaryReport = List.Transpose(lists=create_2)
SummaryReport = Output(summaryReport)
