# Dynamo custom node RevitVersion.dyf (Dynamo 1.3.4.6666)
# category: TFNodes.ModelAudit
# Get the version of main revit file and links

python_script = Python()
# ---------- python_script.python (10 lines) ----------
import clr
clr.AddReference("RevitServices")
import RevitServices
from RevitServices.Persistence import DocumentManager

doc = DocumentManager.Instance.CurrentDBDocument
uiapp = DocumentManager.Instance.CurrentUIApplication
app = uiapp.Application

OUT = app.VersionName, app.VersionNumber, app.VersionBuild, app.Language.ToString()
# ----------------------------------------
code_block = CodeBlock(seq=python_script) { seq[0]; seq[1]; }
MainRevitFile = Output(code_block.out0)
RevitVersion = Output(code_block.out1)
