# Dynamo custom node SqlExecuteNonQuery.dyf (Dynamo 1.3.4.6666)
# category: TFNodes.ModelAudit
# Executes an SQL command (INSERT, UPDATE, DELETE, etc). Takes a single statement or list and returns the number of rows affected by each statement.

# note: Copy and paste the following string nodes into your script.
# Modify them to your liking.
connection_string = StringInput("""Server=station259\sqlexpress;
Database=DPdb; Trusted_Connection=True;""")
sql_statement = StringInput("INSERT INTO auditEvents (idAuditReport, auditType, value) VALUES (1, 'Test', 1.0)")
connectionString = Input(connectionString: string)
sqlStatements = Input(sqlStatements: string[])
python_script = Python(IN[0]=connectionString, IN[1]=sqlStatements)
# ---------- python_script.python (22 lines) ----------
import clr
clr.AddReference('System.Data')
from System.Data.SqlClient import *

connectionString = IN[0]
sqlStatements = IN[1]
	
connection = SqlConnection(connectionString)
connection.Open()

#Generate the list output from SQL dataset
dataOutput=[]

for statement in sqlStatements:
	command = connection.CreateCommand()
	command.CommandText = statement
	dataOutput.Add(command.ExecuteNonQuery())

connection.Close()

#Assign your output to the OUT variable.
OUT= dataOutput
# ----------------------------------------
rows = Output(python_script)
