# Dynamo custom node SqlExecuteQuery.dyf (Dynamo 1.3.4.6666)
# category: TFNodes.ModelAudit
# Connects to an SQL server, executes a query (SELECT statement) and returns the results as a list

connectionString = Input(connectionString: string)
sqlStatement = Input(sqlStatement: string)
python_script = Python(IN[0]=connectionString, IN[1]=sqlStatement)
# ---------- python_script.python (28 lines) ----------
import clr
clr.AddReference('System.Data')
from System.Data.SqlClient import *

connectionString = IN[0]
sqlStatement = IN[1]
	
connection = SqlConnection(connectionString)
connection.Open()
command = connection.CreateCommand()
command.CommandText = sqlStatement
reader = command.ExecuteReader()

countOfColumns = reader.FieldCount

#Generate the list output from SQL dataset
dataOutput=[]
while reader.Read():
	record=[]
	for i in range(0, countOfColumns):
		record.Add(reader[i])
	#reader.GetValues(row)
	dataOutput.Add(record)

connection.Close()

#Assign your output to the OUT variable.
OUT= dataOutput
# ----------------------------------------
records = Output(python_script)
sql_statement = StringInput("""SELECT Preferredname+' '+lastname AS fullname,
initials,
workemail
FROM dpdemployees
WHERE isactive=1
AND initials IS NOT NULL
ORDER BY fullname""")
# note: Copy and paste the following string nodes into your script.
# Modify them to your liking.
connection_string = StringInput("""Server=tf-infocus\clearview;
Database=TurnerFleischer;
Uid=automation;
Password=automation123;""")
