# Dynamo custom node WarningsReport.dyf (Dynamo 1.3.4.6666)
# category: TFNodes.ModelAudit
# Get warnings report and organize it by error msgs, affected element, unique error and number of error

report = Input()
code_block = CodeBlock(report=report) { report:var; }
boolean = BoolSelector(false)
python_script = Python(IN[0]=code_block, IN[1]=boolean)
# ---------- python_script.python (64 lines) ----------
import clr
import System
pf_path = System.Environment.GetFolderPath(System.Environment.SpecialFolder.ProgramFilesX86)
import sys
sys.path.append("%s\IronPython 2.7\Lib" %pf_path)

from sgmllib import SGMLParser
from collections import Counter
import re
from operator import itemgetter

class ReportParser(SGMLParser):
	def __init__(self, verbose=0):
		SGMLParser.__init__(self, verbose)
		self.data1 = []
		self.temp_data = []
	def handle_data(self, data):
		if data != "\n" and data not in known_errors:
			self.temp_data.append(data)
	def unknown_starttag(self, tag, attrs):
		if tag == "tr":
			self.data1.append(self.temp_data)
			self.temp_data = []

def extractId(list1):
	return [i for j in list1 for i in id_expression.findall(j)]
def pullElement(list1):
	out1 = []
	for i in list1:
		try: out1.append(doc.GetElement(ElementId(int(i))))
		except: out1.append(i)
	return out1

report1, fetch_elements = IN

known_errors = ("  ", "td>  ", "&")
parser = ReportParser()
with open(report1, 'r') as f:
	for line in f:
		parser.feed(line)
parser.data1.pop(0)
parser.data1.append(parser.temp_data)
report_data = parser.data1
parser.close()
report_errors = [i.pop(0) for i in report_data]
group_errors = Counter(report_errors).most_common()
unique_errors = map(itemgetter(0), group_errors)
sum_errors = map(itemgetter(1), group_errors)
sum_errors.append("Total errors : %d" % sum(sum_errors) )

#id_expression = re.compile("\D(\d{5,8})\D")
id_expression = re.compile(" id (.*)  ")
elements = map(extractId, report_data)

if fetch_elements:	#imports moved here to be able to process externally
	clr.AddReference("RevitServices")
	from RevitServices.Persistence import DocumentManager
	doc = DocumentManager.Instance.CurrentDBDocument
	clr.AddReference("RevitAPI")
	from Autodesk.Revit.DB import ElementId
	
	elements = map(pullElement, elements)
	
OUT = report_errors, elements, unique_errors, sum_errors
# ----------------------------------------
seq = CodeBlock(res=python_script) { res[0]; res[1]; res[2]; res[3]; }
errorMessage = Output(seq.out0)
AffectedElements = Output(seq.out1)
UniqueErrors = Output(seq.out2)
NumberOfError = Output(seq.out3)
lastItem = List.LastItem(seq.out3)
string = StringInput("Total errors :")
split = String.Split(lastItem, string)
toNumber = String.ToNumber(split)
test = CodeBlock(func=toNumber) { func < 50; }
code_block_2 = CodeBlock { "APPROVED"; "FAILED"; }
if_ = If(test=test, true=code_block_2.out0, false=code_block_2.out1)
firstItem = List.FirstItem(if_)
Status = Output(firstItem)
